# Grasshopper definition viz_zone.gh (Grasshopper 1.0.7)

panel = Panel("""0
0
0
0""")
panel_2 = Panel("""4
4
0
0""")
panel_3 = Panel("""0
2.5
2.5
0""")
panel_4 = Panel("""2.6
2.6
2.6
2.6""")
panel_5 = Panel("""0
0
4
4""")
panel_6 = Panel("""0
2.5
2.5
0""")
pt = Point(Point(24, 0, 0))
panel_7 = Panel(pt)
vec = VectorXYZ(XComponent=panel_3, YComponent=panel_2, ZComponent=panel)  # -> Vector, Length
vec_2 = VectorXYZ(XComponent=panel_6, YComponent=panel_5, ZComponent=panel_4)  # -> Vector, Length
move = Move(Geometry=pt, Motion=vec.Vector)  # -> Geometry, Transform
move_2 = Move(Geometry=pt, Motion=vec_2.Vector)  # -> Geometry, Transform
pline = PolyLine(Vertices=move.Geometry, Closed=True)
pline_2 = PolyLine(Vertices=move_2.Geometry, Closed=True)
points = PointList(Points=move.Geometry, Size="0.5")
points_2 = PointList(Points=move_2.Geometry, Size="0.5")
boundary = BoundarySurfaces(Edges=pline)
boundary_2 = BoundarySurfaces(Edges=pline_2)
